# Grasshopper definition GenerateDemand.gh (Grasshopper 1.0.7)
# plug-ins: UrbanXTools, Geospatial, Human

inputdir = Panel("D:\Code\114_temp\040_UrbanXTools\UrbanXTools_v.3.0.1\UrbanXTools-main\Samples\10_Traffic\input")
outputdir = Panel("D:\Code\114_temp\040_UrbanXTools\UrbanXTools_v.3.0.1\UrbanXTools-main\Samples\10_Traffic\output")

format = Format(Format="{0}\network.xml", Culture=127, Data0=outputdir)
traffic_converttogeojson = Traffic_ConvertToGeojson(Run=Toggle(True), InputFile=format)
read_geojson = ReadGeoJSON(File=traffic_converttogeojson)  # -> Type, Geometry, Keys, Values

traffic_generatedemand = Traffic_GenerateDemand(Run=Toggle(True), InputDir=inputdir, OutputDir=outputdir)
traffic_runsim = Traffic_RunSim(Run=Toggle(True), InputDir=traffic_generatedemand)
curve = Curve(flatten(read_geojson.Geometry))

bounding_box = BoundingBox(Content=curve, Plane=PlaneXY(0, 0, 0), UnionBox=True)  # -> Box, Box_2
certainfacesbydirections = CertainFacesByDirections(brep=bounding_box.Box, tolerance=0.98)  # -> flatten(topsrf), bottomsrf, sidessrf
explode = Explode(Curve=certainfacesbydirections.topsrf, Recursive=True)  # -> Segments, Vertices
unit_y = UnitY(Factor=Slider(100, range=0..100))
list_item = ListItem(List=explode.Vertices, Index=0, Wrap=True)  # -> Item, Item1, Item2
move = Move(Geometry=list_item.Item1, Motion=expr("-x", unit_y))  # -> Geometry, Transform

list_item_2 = ListItem(List=read_geojson.Values, Index=0, Wrap=True)  # -> flatten(Item)
panel = Panel(traffic_runsim)
panel_2 = Panel(traffic_generatedemand)
sort_list = SortList(Keys=list_item_2, ValuesValuesA=curve)  # -> Keys, ValuesValuesA
dispatch = Dispatch(List=sort_list.ValuesValuesA, DispatchPattern=[True, False])  # -> ListA, ListB
number_slider = Slider(30, range=0..100)

number_slider_2 = Slider(16, range=0..23)

format_2 = Format(Format="{0}\output_traffic\ITERS\it.5\5.linkstats.txt.gz", Culture=127, Data0=outputdir)

traffic_linkstats = Traffic_LinkStats(Run=Toggle(True), InputFile=format_2)  # -> LinkID, FromNode, ToNode, FreeSpeed, TravelVolume, AttributeName
list_item_3 = ListItem(List=traffic_linkstats.TravelVolume, Index=number_slider_2, Wrap=True)  # -> flatten(Item)

mass_addition = MassAddition(Input=list_item_3)  # -> Result, PartialResults
sort_list_2 = SortList(Keys=traffic_linkstats.LinkID, ValuesValuesA=list_item_3)  # -> Keys, ValuesValuesA
integer = Integer(mass_addition.Result)

point = Point(move.Geometry)
list_item_4 = ListItem(List=traffic_linkstats.AttributeName, Index=expr("x+5", number_slider_2), Wrap=True)
format_3 = Format(Format="{0}, Total Volume:{1}", Culture=127, Data0=list_item_4, Data1=integer)
text_tag_3d = TextTag3D(Location=point, Text=format_3, Size=Slider(200, range=0..1000), Justification=7)

dispatch_2 = Dispatch(List=sort_list_2.ValuesValuesA, DispatchPattern=[True, False])  # -> ListA, ListB
panel_3 = Panel(mass_addition.Result)
data = Data(dispatch_2.ListB)
bounds = Bounds(Numbers=data)
remap_numbers = RemapNumbers(Value=data, Source=bounds, Target=Domain(0, 1))  # -> Mapped, Clipped
gradient = Gradient(
    LowerLimit=0,
    UpperLimit=1,
    Parameter=remap_numbers.Mapped,
    stops=[0: RGB(0, 128, 0), 0.116: RGB(255, 255, 0), 0.554: RGB(255, 0, 0)])
custom_preview_lineweights = CustomPreviewLineweights(Geometry=dispatch.ListA, Shader=gradient, Thickness=Slider(3, range=0..10), Absolute=False)

# ==== cluster CertainFacesByDirections: get certain faces by direction
brep = ClusterInput()
tolerance = ClusterInput()
debrep = DeconstructBrep(Brep=brep)  # -> Faces, Edges, Vertices
tol = Number(tolerance)
Z = UnitZ(Factor=1)
srfcen = SurfaceCenter(srf=debrep.Faces)  # -> point, normal, frame
dprod = DotProduct(VectorA=srfcen.normal, VectorB=Z, Unitize=True)
abs = Absolute(Value=dprod)
neg = Negative(Value=dprod)
larger = LargerThan(FirstNumber=dprod, SecondNumber=tol)  # -> LargerThan, OrEqualTo
larger_2 = LargerThan(FirstNumber=abs, SecondNumber=tol)  # -> LargerThan, OrEqualTo
larger_3 = LargerThan(FirstNumber=neg, SecondNumber=tol)  # -> LargerThan, OrEqualTo
dispatch = Dispatch(List=debrep.Faces, DispatchPattern=larger.LargerThan)  # -> ListA, ListB
dispatch_2 = Dispatch(List=debrep.Faces, DispatchPattern=larger_3.LargerThan)  # -> ListA, ListB
dispatch_3 = Dispatch(List=debrep.Faces, DispatchPattern=larger_2.LargerThan)  # -> ListA, ListB
top = Srf(dispatch.ListA)
btm = Srf(dispatch_2.ListA)
sides = Srf(dispatch_3.ListB)
topsrf = ClusterOutput(top)
bottomsrf = ClusterOutput(btm)
sidessrf = ClusterOutput(sides)

# ==== cluster SurfaceCenter: Evaluates a surface at UV .5,.5
srf = ClusterInput()
srf_2 = Srf(srf)
evaluate_surface = EvaluateSurface(Surface=reparameterize(srf_2), Point="0.5,0.5,0")  # -> Point, Normal, UDirection, VDirection, Frame
point = ClusterOutput(evaluate_surface.Point)
normal = ClusterOutput(evaluate_surface.Normal)
frame = ClusterOutput(evaluate_surface.Frame)
