# Grasshopper definition PlanningAndTrafficSIM.gh (Grasshopper 1.0.7)
# plug-ins: UrbanXTools, Human, Geospatial

inputdir = Panel("D:\Code\114_temp\040_UrbanXTools\UrbanXTools_v.3.0.1\UrbanXTools-main\Samples\10_Traffic\output")

format = Format(Format="{0}\network.xml", Culture=127, Data0=inputdir)
traffic_converttogeojson = Traffic_ConvertToGeojson(Run=Toggle(True), InputFile=format)
read_geojson = ReadGeoJSON(File=traffic_converttogeojson)  # -> Type, Geometry, Keys, Values

# ---- group: imported sites
curve = Curve([<curve referenced from the Rhino model> x65])

# ---- group: imported road networks
# Legend for panel
# Stand for input data
# Stand for calculation result
curve_2 = Curve([<curve referenced from the Rhino model> x52])

# ---- group: radius
radius_1 = Slider(1200, range=0..10000)
radius_3 = Slider(300, range=0..10000)
radius_2 = Slider(500, range=0..10000)

# ----
merge = Merge(Data1=radius_1, Data2=radius_2, Data3=radius_3)
list_item = ListItem(List=read_geojson.Values, Index=0, Wrap=True)  # -> flatten(Item)
curve_3 = Curve(flatten(read_geojson.Geometry))

bounding_box = BoundingBox(Content=curve_3, Plane=PlaneXY(0, 0, 0), UnionBox=True)  # -> Box, Box_2
certainfacesbydirections = CertainFacesByDirections(brep=bounding_box.Box, tolerance=0.98)  # -> flatten(topsrf), bottomsrf, sidessrf
explode = Explode(Curve=certainfacesbydirections.topsrf, Recursive=True)  # -> Segments, Vertices
unit_y = UnitY(Factor=Slider(100, range=0..100))
list_item_2 = ListItem(List=explode.Vertices, Index=0, Wrap=True)  # -> Item, Item1, Item2
move = Move(Geometry=list_item_2.Item1, Motion=expr("-x", unit_y))  # -> Geometry, Transform

sort_list = SortList(Keys=list_item, ValuesValuesA=curve_3)  # -> Keys, ValuesValuesA

# ----
# visulization_road accessibility
data = Data()
bounds = Bounds(Numbers=data)
deconstruct_domain = DeconstructDomain(Domain=bounds)  # -> Start, End
gradient = Gradient(
    LowerLimit=deconstruct_domain.Start,
    UpperLimit=deconstruct_domain.End,
    Parameter=data,
    stops=[0: RGB(0, 60, 255), 0.293: RGB(0, 128, 0), 0.628: RGB(255, 255, 0), 1: RGB(255, 0, 0)])
custom_preview = CustomPreview(Material=gradient)

# ----
# calculation_road accessibility
boolean_toggle = BooleanToggle(True)
ns_computing3d = NS_Computing3D(RoadsData=curve_2, Radius=radius_2, Merge=boolean_toggle)  # -> MetricChoice, MetricIntegration, MetricMeanDepth, MetricTotalDepth, AngularChoice, AngularIntegration, AngularMeanDepth, AngularTotalDepth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
ns_computing3d_2 = NS_Computing3D(RoadsData=curve_2, Radius=radius_3, Merge=boolean_toggle)  # -> MetricChoice, MetricIntegration, MetricMeanDepth, MetricTotalDepth, AngularChoice, AngularIntegration, AngularMeanDepth, AngularTotalDepth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
ns_computing3d_3 = NS_Computing3D(RoadsData=curve_2, Radius=radius_1, Merge=boolean_toggle)  # -> MetricChoice, MetricIntegration, MetricMeanDepth, MetricTotalDepth, AngularChoice, AngularIntegration, AngularMeanDepth, AngularTotalDepth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

dispatch = Dispatch(List=sort_list.ValuesValuesA, DispatchPattern=[True, False])  # -> ListA, ListB
number_slider = Slider(30, range=0..100)

# ---- group: cleanedRoads
data_2 = Data(ns_computing3d_3.CleanedRoadsData)

# ---- group: imported sites
data_3 = Data(curve)

# ----
# visulization_site accessibility
data_4 = Data()
bounds_2 = Bounds(Numbers=data_4)
deconstruct_domain_2 = DeconstructDomain(Domain=bounds_2)  # -> Start, End
gradient_2 = Gradient(
    LowerLimit=deconstruct_domain_2.Start,
    UpperLimit=deconstruct_domain_2.End,
    Parameter=data_4,
    stops=[0: RGB(12, 82, 235), 0.379: RGB(0, 128, 0), 0.685: RGB(255, 255, 0), 1: RGB(255, 0, 0)])
custom_preview_2 = CustomPreview(Material=gradient_2)

# ----
# calculation_site accessibility
na_siteaccessibility = NA_SiteAccessibility(CleanedRoadsData=data_2, RoadsScores=ns_computing3d_3.NormalisedAngularChoice, SitesCurves=data_3)  # -> SitesPolygons, SiteScores
na_siteaccessibility_2 = NA_SiteAccessibility(CleanedRoadsData=data_2, RoadsScores=ns_computing3d.NormalisedAngularChoice, SitesCurves=data_3)  # -> SitesPolygons, SiteScores
na_siteaccessibility_3 = NA_SiteAccessibility(CleanedRoadsData=data_2, RoadsScores=ns_computing3d_2.NormalisedAngularChoice, SitesCurves=data_3)  # -> SitesPolygons, SiteScores
merge_2 = Merge(
    Data1=graft(na_siteaccessibility.SiteScores),
    Data2=graft(na_siteaccessibility_2.SiteScores),
    Data3=graft(na_siteaccessibility_3.SiteScores))  # -> simplify(Result)

# ---- group: cleanedRoads
data_5 = Data(data_2)

# ---- group: cleanedSites
data_6 = Data(na_siteaccessibility.SitesPolygons)

# ----
area = Area(Geometry=data_6)  # -> Area, Centroid

# ----
# calculation_site clustering
rp_clusteringpoints = RP_ClusteringPoints(SitesCentroid=area.Centroid, Diameters=merge)  # -> ClusterLinks, SiteIds, Out
data_7 = Data(rp_clusteringpoints.ClusterLinks)
data_8 = Data(rp_clusteringpoints.SiteIds)
tree_statistics = TreeStatistics(Tree=data_8)  # -> Paths, Length, Count
cluster = Cluster(tree=data_7)  # -> colour, tree_2
custom_preview_lineweights = CustomPreviewLineweights(Geometry=cluster.tree_2, Shader=simplify(graft(cluster.colour)), Thickness=Slider(3, range=0..10), Absolute=False)

# ----
# calculation_site landuse allocation
landuse_ratio = Panel("""B:0.48
A:0.26
R:0.22
W:0.03
G:0.09
M:0.02""")
na_landuseallocation = NA_LanduseAllocation(SiteCrvs=data_6, SiteScore=merge_2, Clusters=rp_clusteringpoints.Out, LandusePriorityAndPct=landuse_ratio)  # -> SiteLanduse, SitesPercentage, sitePct, model
calcresult_landuse_ratio = Panel(na_landuseallocation.sitePct)
boundary_surfaces = BoundarySurfaces(Edges=graft(na_landuseallocation.SiteLanduse))  # -> flatten(Surfaces)

# ---- group: R
colour_swatch = ColourSwatch(SwatchColor=RGB(255, 247, 0))

# ---- group: A1
colour_swatch_2 = ColourSwatch(SwatchColor=RGB(255, 0, 255))

# ---- group: G
colour_swatch_3 = ColourSwatch(SwatchColor=RGB(109, 168, 0))

# ---- group: B
colour_swatch_4 = ColourSwatch(SwatchColor=RGB(255, 0, 0))

# ---- group: M
colour_swatch_5 = ColourSwatch(SwatchColor=RGB(133, 86, 37))

# ---- group: W
colour_swatch_6 = ColourSwatch(SwatchColor=RGB(37, 42, 133))

# ----
merge_3 = Merge(
    Data1=colour_swatch,
    Data2=colour_swatch_2,
    Data3=colour_swatch_3,
    Data4=colour_swatch_4,
    Data5=colour_swatch_5,
    Data6=colour_swatch_6)
txt = Text(merge_3)
cluster_2 = Cluster_2(L=boundary_surfaces, data=na_landuseallocation.SitesPercentage)  # -> I, i, S
c_script = CSharpScript(labelList=cluster_2.S, colorList=txt)  # -> A; inputs labelList: list of String, colorList: list of String
# ---------- c_script: C# usings ----------
using Rhino.Display;
# ---------- c_script: C# ----------
    DataTree <string> colorOutput = new DataTree<string>();
    for (int i = 0; i < labelList.Count; i++)
    {
      GH_Path path = new GH_Path(i);
      switch (labelList[i])
      {
        case "R":
          colorOutput.Add(colorList[0], path);
          break;
        case "A":
          colorOutput.Add(colorList[1], path);
          break;
        case "G":
          colorOutput.Add(colorList[2], path);
          break;
        case "B":
          colorOutput.Add(colorList[3], path);
          break;
        case "M":
          colorOutput.Add(colorList[4], path);
          break;
        case "W":
          colorOutput.Add(colorList[5], path);
          break;
      }
    }
    A = colorOutput;
# ---------- end c_script ----------
preview = CustomPreview(Geometry=cluster_2.i, Material=c_script)

# ----
# calculation_site accessibility reallocation
na_siteaccessibility_4 = NA_SiteAccessibility(
    CleanedRoadsData=data_5,
    RoadsScores=ns_computing3d_3.NormalisedAngularChoice,
    SitesCurves=na_landuseallocation.SiteLanduse)  # -> SitesPolygons, SiteScores
na_siteaccessibility_5 = NA_SiteAccessibility(
    CleanedRoadsData=data_5,
    RoadsScores=ns_computing3d.NormalisedAngularChoice,
    SitesCurves=na_landuseallocation.SiteLanduse)  # -> SitesPolygons, SiteScores
na_siteaccessibility_6 = NA_SiteAccessibility(
    CleanedRoadsData=data_5,
    RoadsScores=ns_computing3d_2.NormalisedAngularChoice,
    SitesCurves=na_landuseallocation.SiteLanduse)  # -> SitesPolygons, SiteScores
cluster_3 = Cluster_5(data=na_siteaccessibility_5.SiteScores)
cluster_4 = Cluster_5(data=na_siteaccessibility_6.SiteScores)
cluster_5 = Cluster_5(data=na_siteaccessibility_4.SiteScores)
ratio_in_each_kind_of_accessibility = Panel("""0.5
0.3
0.2""")
merge_4 = Merge(Data1=graft(cluster_5), Data2=graft(cluster_3), Data3=graft(cluster_4))  # -> simplify(Result)
c_script_2 = CSharpScript(x=merge_4, y=ratio_in_each_kind_of_accessibility)  # -> flatten(A); inputs x: tree of Double, y: list of Double
# ---------- c_script_2: C# usings ----------
using System.Linq;
# ---------- c_script_2: C# ----------
    DataTree<double> result = new DataTree<double>();
    for (int i = 0; i < x.BranchCount; i++)
    {
      List<double> tempList = new List<double>();
      GH_Path path = new GH_Path(i);
      for (int j = 0; j < x.Branch(i).Count; j++)
      {
        var temp = x.Branch(i)[j]*y[j];
        tempList.Add(temp);
      }
      result.Add(tempList.Sum(),path);
      
    }
    A = result;
# ---------- end c_script_2 ----------

# ----
# calculation_site FAR allocation
construction_area_in_each_landuse = Panel("""B:0.58
A:0.16
R:0.12
W:0.03
G:0.09
M:0.02""")
total_construction_area = Panel("5891000")
rp_farallocation = RP_FarAllocation(
    Model_LanduseAllocation=na_landuseallocation.model,
    TotalArea=total_construction_area,
    FARRatio=construction_area_in_each_landuse,
    InputNach=c_script_2)
area_2 = Area(Geometry=na_landuseallocation.SiteLanduse)  # -> Area, Centroid
cluster_6 = Cluster_8(A=area_2.Area, B=rp_farallocation)
calcresult_total_construction_area = Panel(cluster_6)
cluster_7 = Cluster_7(B=cluster_6, data=na_landuseallocation.SitesPercentage, list_2=area_2.Area, list=rp_farallocation)
calcresult_construction_area_in_each_lan = Panel(cluster_7)  # "CalcResult_Construction Area in Each Landuse"

# ----
# visualization_site Landuse&FAR
number_slider_2 = Slider(300, range=0..1000)
split_argb = SplitARGB(Colour=merge_3, IntegerChannels=True)  # -> Alpha, Red, Green, Blue
cluster_8 = Cluster_4(
    edges=na_landuseallocation.SiteLanduse,
    data_2=na_landuseallocation.SitesPercentage,
    data=rp_farallocation,
    domain_end=number_slider_2)  # -> unit_vector, extrusion, i, S
colour_rgb = ColourRGB(Alpha=Slider(180, range=0..255), Red=split_argb.Red, Green=split_argb.Green, Blue=split_argb.Blue)
move_2 = Move(Geometry=area_2.Centroid, Motion=cluster_8.unit_vector)  # -> Geometry, Transform
c_script_3 = CSharpScript(labelList=cluster_8.S, colorList=colour_rgb)  # -> A; inputs labelList: list of String, colorList: list of Color
# ---------- c_script_3: C# usings ----------
using Rhino.Display;
using System.Drawing;
# ---------- c_script_3: C# ----------
    DataTree <Color> colorOutput = new DataTree<Color>();
    for (int i = 0; i < labelList.Count; i++)
    {
      GH_Path path = new GH_Path(i);
      switch (labelList[i])
      {
        case "R":
          colorOutput.Add(colorList[0], path);
          break;
        case "A":
          colorOutput.Add(colorList[1], path);
          break;
        case "G":
          colorOutput.Add(colorList[2], path);
          break;
        case "B":
          colorOutput.Add(colorList[3], path);
          break;
        case "M":
          colorOutput.Add(colorList[4], path);
          break;
        case "W":
          colorOutput.Add(colorList[5], path);
          break;
      }
    }
    A = colorOutput;
# ---------- end c_script_3 ----------
preview_2 = CustomPreview(Geometry=simplify(cluster_8.i), Material=c_script_3)
text_tag_3d = TextTag3D(
    Location=move_2.Geometry,
    Text=rp_farallocation,
    Size=Slider(22, range=0..100),
    Colour=ColourSwatch(SwatchColor=RGB(0, 0, 0)),
    Justification=7)

brep_wireframe = BrepWireframe(Brep=cluster_8.i, Density=-1)

# ----
# 所属城市
value_list = ValueList({"北京": 0, "上海": 1, "天津": 2, "深圳": 3}, selected="深圳")

curve_4 = Curve(ns_computing3d_3.CleanedRoadsData)

number_slider_3 = Slider(23, range=0..23)

format_2 = Format(Format="{0}\output_traffic\ITERS\it.5\5.linkstats.txt.gz", Culture=127, Data0=inputdir)

traffic_linkstats = Traffic_LinkStats(Run=Toggle(False), InputFile=format_2)  # -> LinkID, FromNode, ToNode, FreeSpeed, TravelVolume, AttributeName
list_item_3 = ListItem(List=traffic_linkstats.TravelVolume, Index=number_slider_3, Wrap=True)  # -> flatten(Item)

mass_addition = MassAddition(Input=list_item_3)  # -> Result, PartialResults
sort_list_2 = SortList(Keys=traffic_linkstats.LinkID, ValuesValuesA=list_item_3)  # -> Keys, ValuesValuesA
integer = Integer(mass_addition.Result)

point = Point(move.Geometry)
list_item_4 = ListItem(List=traffic_linkstats.AttributeName, Index=expr("x+5", number_slider_3), Wrap=True)
format_3 = Format(Format="{0}", Culture=127, Data0=list_item_4, Data1=integer)
text_tag_3d_2 = TextTag3D(Location=point, Text=format_3, Size=Slider(200, range=0..1000), Justification=7)

dispatch_2 = Dispatch(List=sort_list_2.ValuesValuesA, DispatchPattern=[True, False])  # -> ListA, ListB
panel = Panel(mass_addition.Result)
data_9 = Data(dispatch_2.ListB)
data_10 = Data(flatten(traffic_linkstats.TravelVolume))
bounds_3 = Bounds(Numbers=data_10)
remap_numbers = RemapNumbers(Value=data_9, Source=bounds_3, Target=Domain(0, 1))  # -> Mapped, Clipped
gradient_3 = Gradient(
    LowerLimit=0,
    UpperLimit=1,
    Parameter=remap_numbers.Mapped,
    stops=[0: RGB(0, 128, 0), 0.0673: RGB(255, 255, 0), 0.324: RGB(255, 0, 0)])
custom_preview_lineweights_2 = CustomPreviewLineweights(Geometry=dispatch.ListA, Shader=gradient_3, Thickness=Slider(6, range=0..10), Absolute=False)

data_11 = Data(na_landuseallocation.SitesPercentage)
curve_5 = Curve([<curve referenced from the Rhino model> x65])
ud_siteparameter = UD_SiteParameter(CleanedRoadsData=ns_computing3d_3.CleanedRoadsData, RoadsScores=ns_computing3d_3.MetricChoice, SitesCurves=curve_5)

# ---- group: 将数据bake出来
c_script_4 = CSharpScript(x=data_11)  # -> A; inputs x: list of String
# ---------- c_script_4: C# ----------
    Dictionary < string, int> dic = new Dictionary<string, int>(){
        {"R",0},{"B",1},{"A",2},{"W",3},{"M",4}};
    var count = x.Count;
    var result = new int[count];
    for (int i = 0; i < count; i++)
    {
      var name = x[i];
      switch (name)
      {
        case "R":
          result[i] = 0;
          break;
        case "B":
          result[i] = 1;
          break;
        case "A":
          result[i] = 2;
          break;
        case "W":
          result[i] = 3;
          break;
        case "M":
          result[i] = 4;
          break;
      }
    }
    A = result;
# ---------- end c_script_4 ----------
c_script_5 = CSharpScript(x=c_script_4)  # -> BuildingFAR, BuildingDensity, BuildingMixRatio, BuildingStyles, BuildingAngle; inputs x: list of Int32, y: list of Int32
# ---------- c_script_5: C# ----------
    List<double> farList = new List<double>();
    List<double> densityList = new List<double>();
    List<double> mixratioList = new List<double>();
    List<int> styleList = new List<int>();
    List<double> angleList = new List<double>();
    var ran = new Random();
    for (int i = 0; i < x.Count; i++)
    {
      if (x[i] == 0)
      {
        var farKey = ran.NextDouble() * (3d - 0.1) + 0.1;;
        var densityKey = ran.NextDouble() * (0.3 - 0.2) + 0.2;
        var mixratioKey = ran.NextDouble() * (0.3 - 0.1) + 0.1;
        int styleKey = 0;
        var angleKey = ran.NextDouble() * (0.3 - 0d) + 0d;

        farList.Add(farKey);
        mixratioList.Add(mixratioKey);
        densityList.Add(densityKey);
        styleList.Add(styleKey);
        angleList.Add(angleKey);
      }
      else
      {
        var farKey = ran.NextDouble() * (6d - 1d) + 1d;
        var densityKey = ran.NextDouble() * (0.5 - 0.3) + 0.3;
        var mixratioKey = ran.NextDouble() * (0.5 - 0.1) + 0.1;
        //int styleKey = ran.Next(2) + 1;
        var styleTemps = new List<int> (){0,2};
        int styleKey = styleTemps[ran.Next(2)];
        var angleKey = ran.NextDouble() * (0.3 - 0.1) + 0.1;

        farList.Add(farKey);
        mixratioList.Add(mixratioKey);
        densityList.Add(densityKey);
        styleList.Add(styleKey);
        angleList.Add(angleKey);
      }
    }
    BuildingFAR = farList;
    BuildingDensity = densityList;
    BuildingMixRatio = mixratioList;
    BuildingStyles = styleList;
    BuildingAngle = angleList;
# ---------- end c_script_5 ----------
data_12 = Data(rp_farallocation)

# ----
ud_siteparameterextra = UD_SiteParameterExtra(
    SiteParameters=ud_siteparameter,
    SiteTypesEnum=c_script_4,
    TargetFAR=data_12,
    TargetDensity=c_script_5.BuildingDensity,
    MixRatios=c_script_5.BuildingMixRatio,
    BuidlingStyles=c_script_5.BuildingStyles,
    Orientation=c_script_5.BuildingAngle)

# ----
# 3_auto-generate urban design
ud_sitegenerateplans = UD_SiteGeneratePlans(SiteParameters=ud_siteparameterextra, CityIndex=value_list)  # -> SiteResults, Sites, FARs, Densities, SubSites, SubSitesSetbacks, BuildingLayers, BuildingRoofs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

# ----
# visualization_function
cluster_9 = Cluster_9(brep=ud_sitegenerateplans.BuildingBreps, data=ud_sitegenerateplans.BuildingFunctions)  # -> brep_3, color
preview_3 = CustomPreview(Geometry=cluster_9.brep_3, Material=cluster_9.color)

# ----
# visualization
boundary_surfaces_2 = BoundarySurfaces(Edges=ud_sitegenerateplans.SubSitesSetbacks)
boundary_surfaces_3 = BoundarySurfaces(Edges=ud_sitegenerateplans.SubSites)
extrude = Extrude(Base=boundary_surfaces_3, Direction="0,0,0.10")
extrude_2 = Extrude(Base=boundary_surfaces_2, Direction=expr("x*2", "0,0,0.10"))
# visualization
# 3_auto-generate urban design
# 所属城市
# visualization_function
number_slider_4 = Slider(5, range=0..10)
area_3 = Area(Geometry=ud_sitegenerateplans.BuildingRoofs)  # -> Area, Centroid
colour_swatch_7 = ColourSwatch(SwatchColor=RGB(102, 102, 102))
text_tag_3d_3 = TextTag3D(
    Location=area_3.Centroid,
    Text=ud_sitegenerateplans.BuildingFloors,
    Size=number_slider_4,
    Colour=ColourSwatch(SwatchColor=RGB(0, 0, 0)),
    Justification=7)
custom_preview_3 = CustomPreview(Geometry=extrude, Material=ColourSwatch(SwatchColor=RGB(194, 194, 194)))
custom_preview_4 = CustomPreview(Geometry=ud_sitegenerateplans.BuildingBreps, Material=ColourSwatch(SwatchColor=RGBA(255, 255, 255, 197)))
custom_preview_5 = CustomPreview(Geometry=ud_sitegenerateplans.BuildingLayers, Material=colour_swatch_7)
custom_preview_6 = CustomPreview(Geometry=extrude_2, Material=ColourSwatch(SwatchColor=RGB(141, 171, 82)))

panel_2 = Panel(ud_sitegenerateplans.FARs)
panel_3 = Panel(ud_sitegenerateplans.Densities)
custom_preview_7 = CustomPreview(Geometry=ud_sitegenerateplans.BuildingRoofs, Material=colour_swatch_7)

text = Text(ud_sitegenerateplans.BuildingFunctions)
brep = Brep(ud_sitegenerateplans.BuildingBreps)
data_13 = Data(flatten(text))
data_14 = Data(flatten(brep))
panel_4 = Panel("""floors
totalArea
function
baseHeight
topHeight""")
certainfacesbydirections_2 = CertainFacesByDirections(brep=data_14, tolerance=0.98)  # -> flatten(topsrf), flatten(bottomsrf), sidessrf
area_4 = Area(Geometry=certainfacesbydirections_2.topsrf)  # -> Area, Centroid
area_5 = Area(Geometry=certainfacesbydirections_2.bottomsrf)  # -> Area, Centroid
deconstruct = Deconstruct(Point=area_5.Centroid)  # -> XComponent, YComponent, ZComponent
deconstruct_2 = Deconstruct(Point=area_4.Centroid)  # -> XComponent, YComponent, ZComponent
list_length = ListLength(List=certainfacesbydirections_2.topsrf)
subtraction = Subtraction(A=deconstruct_2.ZComponent, B=deconstruct.ZComponent)
series = Series(Start=0, Step=1, Count=list_length)  # -> graft(Series)
division = Division(A=subtraction, B=3)
multiplication = Multiplication(A=division, B=area_4.Area)
entwine = Entwine(
    Branch00=division,
    Branch01=multiplication,
    Branch02=data_13,
    Branch03=deconstruct.ZComponent,
    Branch04=deconstruct_2.ZComponent,
    FlattenInputs=True)
flip_matrix = FlipMatrix(Data=entwine)  # -> simplify(Data)
cross_reference = CrossReference(ListListA=panel_4, ListListB=series, CrossMode=1)  # -> simplify(ListListA), ListListB

panel_5 = Panel("D:\Code\114_temp\040_UrbanXTools\UrbanXTools_v.3.0.1\UrbanXTools-main\Samples\10_Traffic\input")
feature_from_polygons = FeatureFromPolygons(Polygons=simplify(graft(certainfacesbydirections_2.bottomsrf)), Keys=cross_reference.ListListA, Values=flip_matrix)
boolean_toggle_2 = BooleanToggle(False)
join_geojson = JoinGeoJSON(Features=flatten(feature_from_polygons))
write_file = WriteFile(Directory=panel_5, Filename="building.geojson", Data=join_geojson, Run=boolean_toggle_2, Overwrite=boolean_toggle_2)

feature_from_lines = FeatureFromLines(Curves=graft(curve_4))
boolean_toggle_3 = BooleanToggle(False)
join_geojson_2 = JoinGeoJSON(Features=flatten(feature_from_lines))
write_file_2 = WriteFile(Directory=panel_5, Filename="roadnetwork.geojson", Data=join_geojson_2, Run=boolean_toggle_3, Overwrite=boolean_toggle_3)

# ==== cluster Cluster
tree = ClusterInput()
trim_tree = TrimTree(Tree=tree, Depth=1)
tree_2 = ClusterOutput(trim_tree)
tree_statistics = TreeStatistics(Tree=trim_tree)  # -> Paths, Length, Count
series = Series(Start=0, Step=1, Count=tree_statistics.Count)
bounds = Bounds(Numbers=series)
remap_numbers = RemapNumbers(Value=series, Source=bounds, Target=Domain(0, 1))  # -> Mapped, Clipped
gradient = Gradient(
    LowerLimit=0,
    UpperLimit=1,
    Parameter=remap_numbers.Mapped,
    stops=[0: RGB(0, 128, 0), 0.5: RGB(255, 255, 0), 1: RGB(255, 0, 0)])
colour = ClusterOutput(gradient)

# ==== cluster Cluster_2
data = ClusterInput()
L = ClusterInput()

data_2 = Data(flatten(data))
cset = CreateSet(List=data_2)  # -> Set, Map
mindex = MemberIndex(Set=data_2, Member=cset.Set)  # -> Index, Count
item = ListItem(List=L, Index=mindex.Index, Wrap=True)

S = ClusterOutput(cset.Set)
I = ClusterOutput(mindex.Index)
i = ClusterOutput(item)

# ==== cluster Cluster_4
domain_end = ClusterInput()
construct_domain = ConstructDomain(DomainStart="1", DomainEnd=domain_end)
data = ClusterInput()
data_2 = ClusterInput()
edges = ClusterInput()
data_3 = Data(data)
bounds = Bounds(Numbers=data_3)
boundary_surfaces = BoundarySurfaces(Edges=graft(edges))
remap_numbers = RemapNumbers(Value=data_3, Source=bounds, Target=Domain(0, 1))  # -> Mapped, Clipped
graph_mapper = GraphMapper(
    remap_numbers.Mapped,
    x0=0,
    x1=1,
    y0=0,
    y1=1,
    container_name="Bezier",
    cpx=[0, 0.7485014796, 0.5181000829, 1],
    cpy=[0, 0.2153329253, 0.5784673691, 0.8697323799])
remap_numbers_2 = RemapNumbers(Value=graph_mapper, Source=Domain(0, 1), Target=construct_domain)  # -> Mapped, Clipped
unit_z = UnitZ(Factor=remap_numbers_2.Mapped)
extrude = Extrude(Base=boundary_surfaces, Direction=graft(unit_z))
cluster = Cluster_3(L=flatten(extrude), data=data_2)  # -> I, i, panel_2
unit_vector = ClusterOutput(unit_z)
extrusion = ClusterOutput(extrude)
i = ClusterOutput(cluster.i)
S = ClusterOutput(cluster.panel_2)

# ==== cluster Cluster_5
data = ClusterInput()
data_2 = Data(data)
bounds = Bounds(Numbers=data_2)
remap_numbers = RemapNumbers(Value=data_2, Source=bounds, Target=Domain(0, 1))  # -> Mapped, Clipped
mapped = ClusterOutput(remap_numbers.Mapped)

# ==== cluster Cluster_7
data = ClusterInput()
list = ClusterInput()
list_2 = ClusterInput()
data_2 = Data(data)
cluster = Cluster_6(list=list, data=data_2)  # -> i, set
cluster_2 = Cluster_6(list=list_2, data=data_2)  # -> i, set
multiplication = Multiplication(A=cluster_2.i, B=cluster.i)
mass_addition = MassAddition(Input=multiplication)  # -> Result, PartialResults
B = ClusterInput()
division = Division(A=mass_addition.Result, B=B)
concatenate = Concatenate(Fragment_A=cluster_2.set, Fragment_B=flatten(":"), A=flatten(division))
result = ClusterOutput(concatenate)

# ==== cluster Cluster_8
A = ClusterInput()
B = ClusterInput()
multiplication = Multiplication(A=A, B=B)
mass_addition = MassAddition(Input=multiplication)  # -> Result, PartialResults
result = ClusterOutput(mass_addition.Result)

# ==== cluster Cluster_9
brep = ClusterInput()
data = ClusterInput()

# ---- group: H
colour_swatch = ColourSwatch(SwatchColor=RGB(245, 177, 5))

# ---- group: R
colour_swatch_2 = ColourSwatch(SwatchColor=RGB(255, 225, 0))

# ---- group: o
colour_swatch_3 = ColourSwatch(SwatchColor=RGBA(200, 0, 255, 210))

# ---- group: M
colour_swatch_4 = ColourSwatch(SwatchColor=RGB(12, 69, 112))

# ---- group: W
colour_swatch_5 = ColourSwatch(SwatchColor=RGB(104, 75, 150))

# ---- group: c
colour_swatch_6 = ColourSwatch(SwatchColor=RGB(212, 15, 15))

# ----
brep_2 = Brep(flatten(brep))
data_2 = Data(flatten(data))
cset = CreateSet(List=data_2)  # -> Set, Map
mindex = MemberIndex(Set=data_2, Member=cset.Set)  # -> Index, Count
item = ListItem(List=brep_2, Index=mindex.Index, Wrap=True)

merge = Merge(
    Data1=colour_swatch_6,
    Data2=colour_swatch,
    Data3=colour_swatch_2,
    Data4=colour_swatch_3,
    Data5=colour_swatch_4,
    Data6=colour_swatch_5)
txt = Text(merge)
c_script = CSharpScript(labelList=cset.Set, colorList=txt)  # -> A; inputs labelList: list of String, colorList: list of String
# ---------- c_script: C# usings ----------
using Rhino.Display;
# ---------- c_script: C# ----------
    DataTree <string> colorOutput = new DataTree<string>();
    for (int i = 0; i < labelList.Count; i++)
    {
      GH_Path path = new GH_Path(i);
      switch (labelList[i])
      {
        case "C":
          colorOutput.Add(colorList[0], path);
          break;
        case "H":
          colorOutput.Add(colorList[1], path);
          break;
        case "R":
          colorOutput.Add(colorList[2], path);
          break;
        case "O":
          colorOutput.Add(colorList[3], path);
          break;
        case "M":
          colorOutput.Add(colorList[4], path);
          break;
        case "W":
          colorOutput.Add(colorList[5], path);
          break;
      }
    }
    A = colorOutput;
# ---------- end c_script ----------
brep_3 = ClusterOutput(item)
color = ClusterOutput(c_script)

# ==== cluster CertainFacesByDirections: get certain faces by direction
brep = ClusterInput()
tolerance = ClusterInput()
debrep = DeconstructBrep(Brep=brep)  # -> Faces, Edges, Vertices
tol = Number(tolerance)
Z = UnitZ(Factor=1)
srfcen = SurfaceCenter(srf=debrep.Faces)  # -> point, normal, frame
dprod = DotProduct(VectorA=srfcen.normal, VectorB=Z, Unitize=True)
abs = Absolute(Value=dprod)
neg = Negative(Value=dprod)
larger = LargerThan(FirstNumber=dprod, SecondNumber=tol)  # -> LargerThan, OrEqualTo
larger_2 = LargerThan(FirstNumber=abs, SecondNumber=tol)  # -> LargerThan, OrEqualTo
larger_3 = LargerThan(FirstNumber=neg, SecondNumber=tol)  # -> LargerThan, OrEqualTo
dispatch = Dispatch(List=debrep.Faces, DispatchPattern=larger.LargerThan)  # -> ListA, ListB
dispatch_2 = Dispatch(List=debrep.Faces, DispatchPattern=larger_3.LargerThan)  # -> ListA, ListB
dispatch_3 = Dispatch(List=debrep.Faces, DispatchPattern=larger_2.LargerThan)  # -> ListA, ListB
top = Srf(dispatch.ListA)
btm = Srf(dispatch_2.ListA)
sides = Srf(dispatch_3.ListB)
topsrf = ClusterOutput(top)
bottomsrf = ClusterOutput(btm)
sidessrf = ClusterOutput(sides)

# ==== cluster Cluster_3
data = ClusterInput()
panel = Panel("""M
W
R
A
B""")
L = ClusterInput()

data_2 = Data(flatten(data))
cset = CreateSet(List=data_2)  # -> Set, Map
mindex = MemberIndex(Set=data_2, Member=panel)  # -> Index, Count
item = ListItem(List=L, Index=mindex.Index, Wrap=True)

I = ClusterOutput(mindex.Index)
panel_2 = ClusterOutput(panel)
i = ClusterOutput(item)

# ==== cluster Cluster_6
data = ClusterInput()
data_2 = Data(data)
create_set = CreateSet(List=data_2)  # -> Set, Map
member_index = MemberIndex(Set=data_2, Member=create_set.Set)  # -> Index, Count
list = ClusterInput()
list_item = ListItem(List=list, Index=member_index.Index, Wrap=True)  # -> simplify(Item)
i = ClusterOutput(list_item)
set = ClusterOutput(create_set.Set)

# ==== cluster SurfaceCenter: Evaluates a surface at UV .5,.5
srf = ClusterInput()
srf_2 = Srf(srf)
evaluate_surface = EvaluateSurface(Surface=reparameterize(srf_2), Point="0.5,0.5,0")  # -> Point, Normal, UDirection, VDirection, Frame
point = ClusterOutput(evaluate_surface.Point)
normal = ClusterOutput(evaluate_surface.Normal)
frame = ClusterOutput(evaluate_surface.Frame)
