# Grasshopper definition ExposureRates3D.gh (Grasshopper 1.0.7)
# plug-ins: UrbanXTools, Human

subdivision = Slider(10, range=0..100)
number_slider = Slider(10, range=0..10)

# ----
# imported road networks
curve = Curve([<curve referenced from the Rhino model> x20])

# ----
# building breps
brep = Brep([<brep referenced from the Rhino model> x115])

# ---- group: extractBtnCrv
bounding_box = BoundingBox(Content=brep, Plane=PlaneXY(0, 0, 0), UnionBox=True)  # -> Box, Box_2
certainfacesbydirections = CertainFacesByDirections(brep=bounding_box.Box, tolerance=0.98)  # -> flatten(topsrf), bottomsrf, sidessrf
brep_edges = BrepEdges(Brep=certainfacesbydirections.bottomsrf)  # -> Naked, Interior, NonManifold
join_curves = JoinCurves(Curves=brep_edges.Naked, Preserve=False)

# ----
spatial_analysis_generatemesh_buildings = Spatial_Analysis_GenerateMesh_Buildings(Brep=brep, SubdivisionSize=subdivision)
divide_length = DivideLength(Curve=curve, Length=Slider(50, range=0..100))  # -> Points, Tangents, Parameters
cull_duplicates = CullDuplicates(Points=flatten(divide_length.Points), Tolerance=0.1, CullMode=3)  # -> Points, Indices, Valence
number_slider_2 = Slider(500, range=0..1000)

# ----
# view points
point = Point(cull_duplicates.Points)

# ---- group: visual syntax
segmentlength = Slider(100, range=0..100)
ns_roadssplitter = NS_RoadsSplitter(OriginalCurves=curve)
spatial_analysis_visualcalc = Spatial_Analysis_VisualCalc(
    ViewRoads=ns_roadssplitter,
    GeneratedMeshClass=spatial_analysis_generatemesh_buildings,
    DivideLength=segmentlength,
    ViewRange=300,
    ExportMesh=Toggle(False),
    Beta=0)  # -> CleanedRoads, PtsOnRoad, VisData, ColoredMesh
list_item = ListItem(List=spatial_analysis_visualcalc.VisData, Index=0, Wrap=True)  # -> Item, Item1, flatten(Item2), Item3
va_visualsyntaxcompute = VA_VisualSyntaxCompute(
    CleanedRoads=flatten(spatial_analysis_visualcalc.CleanedRoads),
    ScoreOnRoads=flatten(list_item.Item2),
    Radius="-1",
    Merge=True)  # -> VisualTotalDepth, VisualMeanDepth, VisualIntegration, VisualChoice, NodeCount, CleanedRoad
data = Data(va_visualsyntaxcompute.VisualChoice)
bounds = Bounds(Numbers=data)
remap_numbers = RemapNumbers(Value=data, Source=bounds, Target=Domain(0, 1))  # -> Mapped, Clipped
gradient = Gradient(
    LowerLimit=0,
    UpperLimit=1,
    Parameter=remap_numbers.Mapped,
    stops=[0: RGB(29, 57, 171), 0.337: RGB(0, 128, 0), 0.654: RGB(255, 255, 0), 1: RGB(255, 0, 0)])
custom_preview_lineweights = CustomPreviewLineweights(Geometry=spatial_analysis_visualcalc.CleanedRoads, Shader=gradient, Thickness=Slider(3, range=0..10), Absolute=False)

# ----
circle = Circle(Plane=point, Radius=number_slider_2)
spatial_analysis_exposurerate3d_building = Spatial_Analysis_ExposureRate3D_Buildings(
    ViewPt=point,
    GeneratedMeshClass=spatial_analysis_generatemesh_buildings,
    ViewRange=number_slider_2,
    CurveRange=join_curves)  # -> ColoredSidesMesh, UnColoredTopMesh, MeshIntrCount, VisData
custom_preview = CustomPreview(
    Geometry=circle,
    Material={diffuse=RGB(221, 160, 221), emission=RGB(66, 48, 66), shine=0.5, specular=RGB(255, 255, 255), transparency=0})

list_item_2 = ListItem(List=spatial_analysis_exposurerate3d_building.VisData, Index=0, Wrap=True)  # -> Item, Item1, Item2, Item3
cluster = Cluster(data=flatten(list_item_2.Item))
gradient_2 = Gradient(LowerLimit=0, UpperLimit=1, Parameter=cluster, stops=[0: RGB(0, 128, 0), 0.248: RGB(255, 255, 0), 1: RGB(255, 0, 0)])
dot_display = DotDisplay(Point=point, Colour=gradient_2, Size=Slider(11, range=0..100))

# ---- group: adjust color
cluster_2 = Cluster(data=spatial_analysis_exposurerate3d_building.MeshIntrCount)
deconstruct_mesh = DeconstructMesh(Mesh=spatial_analysis_exposurerate3d_building.ColoredSidesMesh)  # -> Vertices, Faces, Colours, Normals
gradient_3 = Gradient(LowerLimit=0, UpperLimit=1, Parameter=cluster_2, stops=[0: RGB(0, 128, 0), 0.5: RGB(255, 255, 0), 1: RGB(255, 0, 0)])
construct_mesh = ConstructMesh(Vertices=deconstruct_mesh.Vertices, Faces=deconstruct_mesh.Faces, Colours=gradient_3)

# ==== cluster Cluster
data = ClusterInput()
data_2 = Data(data)
bounds = Bounds(Numbers=data_2)
remap_numbers = RemapNumbers(Value=data_2, Source=bounds, Target=Domain(0, 1))  # -> Mapped, Clipped
mapped = ClusterOutput(remap_numbers.Mapped)

# ==== cluster CertainFacesByDirections: get certain faces by direction
brep = ClusterInput()
tolerance = ClusterInput()
debrep = DeconstructBrep(Brep=brep)  # -> Faces, Edges, Vertices
tol = Number(tolerance)
Z = UnitZ(Factor=1)
srfcen = SurfaceCenter(srf=debrep.Faces)  # -> point, normal, frame
dprod = DotProduct(VectorA=srfcen.normal, VectorB=Z, Unitize=True)
abs = Absolute(Value=dprod)
neg = Negative(Value=dprod)
larger = LargerThan(FirstNumber=dprod, SecondNumber=tol)  # -> LargerThan, OrEqualTo
larger_2 = LargerThan(FirstNumber=abs, SecondNumber=tol)  # -> LargerThan, OrEqualTo
larger_3 = LargerThan(FirstNumber=neg, SecondNumber=tol)  # -> LargerThan, OrEqualTo
dispatch = Dispatch(List=debrep.Faces, DispatchPattern=larger.LargerThan)  # -> ListA, ListB
dispatch_2 = Dispatch(List=debrep.Faces, DispatchPattern=larger_3.LargerThan)  # -> ListA, ListB
dispatch_3 = Dispatch(List=debrep.Faces, DispatchPattern=larger_2.LargerThan)  # -> ListA, ListB
top = Srf(dispatch.ListA)
btm = Srf(dispatch_2.ListA)
sides = Srf(dispatch_3.ListB)
topsrf = ClusterOutput(top)
bottomsrf = ClusterOutput(btm)
sidessrf = ClusterOutput(sides)

# ==== cluster SurfaceCenter: Evaluates a surface at UV .5,.5
srf = ClusterInput()
srf_2 = Srf(srf)
evaluate_surface = EvaluateSurface(Surface=reparameterize(srf_2), Point="0.5,0.5,0")  # -> Point, Normal, UDirection, VDirection, Frame
point = ClusterOutput(evaluate_surface.Point)
normal = ClusterOutput(evaluate_surface.Normal)
frame = ClusterOutput(evaluate_surface.Frame)
