# Grasshopper definition ExposureRates3D_mesh_Through_Points.gh (Grasshopper 1.0.7)
# plug-ins: UrbanXTools

brep = Brep(<brep referenced from the Rhino model>)
populate_3d = Populate3D(Region=brep, Count=100, Seed=1)

# ---- group: imported mesh
mesh = Mesh([<mesh referenced from the Rhino model> x38])

# ---- group: visiting path
curve = Curve(<curve referenced from the Rhino model>)

# ----
mesh_join = MeshJoin(Meshes=mesh)
weld_mesh = WeldMesh(Mesh=mesh_join, Angle=3.141592654)
spatial_analysis_generatemesh_mesh = Spatial_Analysis_GenerateMesh_Mesh(Mesh=weld_mesh, VisualGraphCalc=False)
view_radius = Slider(100, range=0..100)

divide_curve = DivideCurve(Curve=curve, Count=10, Kinks=False)  # -> Points, Tangents, Parameters

data = Data(populate_3d)
spatial_analysis_exposurerate3d_mesh = Spatial_Analysis_ExposureRate3D_Mesh(ViewPt=data, GeneratedMeshClass=spatial_analysis_generatemesh_mesh, ViewRange=view_radius)  # -> ColoredMesh, MeshIntrCount, VisData

# ---- group: adjust color
cluster = Cluster(data=spatial_analysis_exposurerate3d_mesh.MeshIntrCount)
deconstruct_mesh = DeconstructMesh(Mesh=spatial_analysis_exposurerate3d_mesh.ColoredMesh)  # -> Vertices, Faces, Colours, Normals
gradient = Gradient(LowerLimit=0, UpperLimit=1, Parameter=cluster, stops=[0: RGB(0, 128, 0), 0.5: RGB(255, 255, 0), 1: RGB(255, 0, 0)])
construct_mesh = ConstructMesh(Vertices=deconstruct_mesh.Vertices, Faces=deconstruct_mesh.Faces, Colours=gradient)

# ---- group: highlight value
panel = Panel(spatial_analysis_exposurerate3d_mesh.VisData)
list_item = ListItem(List=panel, Index=0, Wrap=True)  # -> flatten(Item)
ghpython_script = GhPythonScript(x=list_item)  # -> a; inputs x: list
# ---------- ghpython_script: Python ----------
result=[]
for i in range(len(x)):
    result.append(round(x[i],2))
a=result
# ---------- end ghpython_script ----------
text_tag_3d = TextTag3D(Location=data, Text=ghpython_script, Size=1, Colour=ColourSwatch(SwatchColor=RGB(0, 0, 0)), Justification=7)

# ----
cluster_2 = Cluster(data=list_item)

gradient_2 = Gradient(LowerLimit=0, UpperLimit=1, Parameter=cluster_2, stops=[0: RGB(0, 128, 0), 0.5: RGB(255, 255, 0), 1: RGB(255, 0, 0)])
cloud_display = CloudDisplay(Points=data, Colours=gradient_2, Size=Slider(2, range=0..10), SpriteType=0)

# ==== cluster Cluster
data = ClusterInput()
data_2 = Data(data)
bounds = Bounds(Numbers=data_2)
remap_numbers = RemapNumbers(Value=data_2, Source=bounds, Target=Domain(0, 1))  # -> Mapped, Clipped
mapped = ClusterOutput(remap_numbers.Mapped)
