# Grasshopper definition Aided Regulatory Planning.gh (Grasshopper 1.0.7)
# plug-ins: UrbanXTools, Human, Geospatial

# ---- group: radius
radius_1 = Slider(1200, range=0..10000)
radius_3 = Slider(300, range=0..10000)
radius_2 = Slider(500, range=0..10000)

# ---- group: imported road networks
# Legend for panel
# Stand for input data
# Stand for calculation result
curve = Curve([<curve referenced from the Rhino model> x41])

# ---- group: imported sites(closed curves)
curve_2 = Curve([<curve referenced from the Rhino model> x85])

# ----
merge = Merge(Data1=radius_1, Data2=radius_2, Data3=radius_3)

# ----
# visulization_road accessibility
data = Data()
bounds = Bounds(Numbers=data)
deconstruct_domain = DeconstructDomain(Domain=bounds)  # -> Start, End
gradient = Gradient(
    LowerLimit=deconstruct_domain.Start,
    UpperLimit=deconstruct_domain.End,
    Parameter=data,
    stops=[0: RGB(0, 60, 255), 0.293: RGB(0, 128, 0), 0.628: RGB(255, 255, 0), 1: RGB(255, 0, 0)])
custom_preview = CustomPreview(Material=gradient)

# ----
# calculation_road accessibility
boolean_toggle = BooleanToggle(True)
ns_computing3d = NS_Computing3D(RoadsData=curve, Radius=radius_1, Merge=boolean_toggle)  # -> MetricChoice, MetricIntegration, MetricMeanDepth, MetricTotalDepth, AngularChoice, AngularIntegration, AngularMeanDepth, AngularTotalDepth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
ns_computing3d_2 = NS_Computing3D(RoadsData=curve, Radius=radius_2, Merge=boolean_toggle)  # -> MetricChoice, MetricIntegration, MetricMeanDepth, MetricTotalDepth, AngularChoice, AngularIntegration, AngularMeanDepth, AngularTotalDepth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
ns_computing3d_3 = NS_Computing3D(RoadsData=curve, Radius=radius_3, Merge=boolean_toggle)  # -> MetricChoice, MetricIntegration, MetricMeanDepth, MetricTotalDepth, AngularChoice, AngularIntegration, AngularMeanDepth, AngularTotalDepth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

# ---- group: cleanedRoads
data_2 = Data(ns_computing3d.CleanedRoadsData)

# ---- group: imported sites
data_3 = Data(curve_2)

# ----
# visulization_site accessibility
data_4 = Data()
bounds_2 = Bounds(Numbers=data_4)
deconstruct_domain_2 = DeconstructDomain(Domain=bounds_2)  # -> Start, End
gradient_2 = Gradient(
    LowerLimit=deconstruct_domain_2.Start,
    UpperLimit=deconstruct_domain_2.End,
    Parameter=data_4,
    stops=[0: RGB(12, 82, 235), 0.379: RGB(0, 128, 0), 0.685: RGB(255, 255, 0), 1: RGB(255, 0, 0)])
custom_preview_2 = CustomPreview(Material=gradient_2)

# ----
# calculation_site accessibility
na_siteaccessibility = NA_SiteAccessibility(CleanedRoadsData=data_2, RoadsScores=ns_computing3d.NormalisedAngularChoice, SitesCurves=data_3)  # -> SitesPolygons, SiteScores
na_siteaccessibility_2 = NA_SiteAccessibility(CleanedRoadsData=data_2, RoadsScores=ns_computing3d_2.NormalisedAngularChoice, SitesCurves=data_3)  # -> SitesPolygons, SiteScores
na_siteaccessibility_3 = NA_SiteAccessibility(CleanedRoadsData=data_2, RoadsScores=ns_computing3d_3.NormalisedAngularChoice, SitesCurves=data_3)  # -> SitesPolygons, SiteScores
merge_2 = Merge(
    Data1=graft(na_siteaccessibility.SiteScores),
    Data2=graft(na_siteaccessibility_2.SiteScores),
    Data3=graft(na_siteaccessibility_3.SiteScores))  # -> simplify(Result)

# ---- group: cleanedRoads
data_5 = Data(data_2)

# ---- group: cleanedSites
data_6 = Data(na_siteaccessibility.SitesPolygons)

# ----
area = Area(Geometry=data_6)  # -> Area, Centroid

# ----
# calculation_site clustering
rp_clusteringpoints = RP_ClusteringPoints(SitesCentroid=area.Centroid, Diameters=merge)  # -> ClusterLinks, SiteIds, Out
data_7 = Data(rp_clusteringpoints.ClusterLinks)
data_8 = Data(rp_clusteringpoints.SiteIds)
tree_statistics = TreeStatistics(Tree=data_8)  # -> Paths, Length, Count
cluster = Cluster(tree=data_7)  # -> colour, tree_2
custom_preview_lineweights = CustomPreviewLineweights(Geometry=cluster.tree_2, Shader=simplify(graft(cluster.colour)), Thickness=Slider(3, range=0..10), Absolute=False)

# ----
# calculation_site landuse allocation
landuse_ratio = Panel("""A:0.06
B:0.50
R:0.32
W:0.10
G:0.04
M:0""")
na_landuseallocation = NA_LanduseAllocation(SiteCrvs=data_6, SiteScore=merge_2, Clusters=rp_clusteringpoints.Out, LandusePriorityAndPct=landuse_ratio)  # -> SiteLanduse, SitesPercentage, sitePct, model
calcresult_landuse_ratio = Panel(na_landuseallocation.sitePct)
boundary_surfaces = BoundarySurfaces(Edges=graft(na_landuseallocation.SiteLanduse))  # -> flatten(Surfaces)

# ---- group: R
colour_swatch = ColourSwatch(SwatchColor=RGB(255, 247, 0))

# ---- group: A1
colour_swatch_2 = ColourSwatch(SwatchColor=RGB(255, 0, 255))

# ---- group: G
colour_swatch_3 = ColourSwatch(SwatchColor=RGB(109, 168, 0))

# ---- group: B
colour_swatch_4 = ColourSwatch(SwatchColor=RGB(255, 0, 0))

# ---- group: M
colour_swatch_5 = ColourSwatch(SwatchColor=RGB(133, 86, 37))

# ---- group: W
colour_swatch_6 = ColourSwatch(SwatchColor=RGB(37, 42, 133))

# ----
merge_3 = Merge(
    Data1=colour_swatch,
    Data2=colour_swatch_2,
    Data3=colour_swatch_3,
    Data4=colour_swatch_4,
    Data5=colour_swatch_5,
    Data6=colour_swatch_6)
txt = Text(merge_3)
cluster_2 = Cluster_2(L=boundary_surfaces, data=na_landuseallocation.SitesPercentage)  # -> I, i, S
c_script = CSharpScript(labelList=cluster_2.S, colorList=txt)  # -> A; inputs labelList: list of String, colorList: list of String
# ---------- c_script: C# usings ----------
using Rhino.Display;
# ---------- c_script: C# ----------
    DataTree <string> colorOutput = new DataTree<string>();
    for (int i = 0; i < labelList.Count; i++)
    {
      GH_Path path = new GH_Path(i);
      switch (labelList[i])
      {
        case "R":
          colorOutput.Add(colorList[0], path);
          break;
        case "A":
          colorOutput.Add(colorList[1], path);
          break;
        case "G":
          colorOutput.Add(colorList[2], path);
          break;
        case "B":
          colorOutput.Add(colorList[3], path);
          break;
        case "M":
          colorOutput.Add(colorList[4], path);
          break;
        case "W":
          colorOutput.Add(colorList[5], path);
          break;
      }
    }
    A = colorOutput;
# ---------- end c_script ----------
preview = CustomPreview(Geometry=cluster_2.i, Material=c_script)

# ----
# calculation_site accessibility reallocation
na_siteaccessibility_4 = NA_SiteAccessibility(
    CleanedRoadsData=data_5,
    RoadsScores=ns_computing3d.NormalisedAngularChoice,
    SitesCurves=na_landuseallocation.SiteLanduse)  # -> SitesPolygons, SiteScores
na_siteaccessibility_5 = NA_SiteAccessibility(
    CleanedRoadsData=data_5,
    RoadsScores=ns_computing3d_2.NormalisedAngularChoice,
    SitesCurves=na_landuseallocation.SiteLanduse)  # -> SitesPolygons, SiteScores
na_siteaccessibility_6 = NA_SiteAccessibility(
    CleanedRoadsData=data_5,
    RoadsScores=ns_computing3d_3.NormalisedAngularChoice,
    SitesCurves=na_landuseallocation.SiteLanduse)  # -> SitesPolygons, SiteScores
cluster_3 = Cluster_4(data=na_siteaccessibility_4.SiteScores)
cluster_4 = Cluster_4(data=na_siteaccessibility_5.SiteScores)
cluster_5 = Cluster_4(data=na_siteaccessibility_6.SiteScores)
merge_4 = Merge(Data1=simplify(graft(cluster_3)), Data2=simplify(graft(cluster_4)), Data3=simplify(graft(cluster_5)))  # -> simplify(Result)
ratio_in_each_kind_of_accessibility = Panel("""0.5
0.3
0.2""")
c_script_2 = CSharpScript(x=merge_4, y=ratio_in_each_kind_of_accessibility)  # -> flatten(A); inputs x: tree of Double, y: list of Double
# ---------- c_script_2: C# usings ----------
using System.Linq;
# ---------- c_script_2: C# ----------
    DataTree<double> result = new DataTree<double>();
    for (int i = 0; i < x.BranchCount; i++)
    {
      List<double> tempList = new List<double>();
      GH_Path path = new GH_Path(i);
      for (int j = 0; j < x.Branch(i).Count; j++)
      {
        var temp = x.Branch(i)[j]*y[j];
        tempList.Add(temp);
      }
      result.Add(tempList.Sum(),path);
      
    }
    A = result;
# ---------- end c_script_2 ----------

# ---- group: Add New Value / 新加的权重值
list_length = ListLength(List=cluster_5)
series = Series(Start=0, Step=1, Count=list_length)

# ---- group: Add New Value
panel = Panel(series)
panel_2 = Panel(merge_4)

# ----
# calculation_site FAR allocation
construction_area_in_each_landuse = Panel("""A:0.073366
B:0.453912
G:0
M:0
W:0.08552
R:0.387200""")
total_construction_area = Panel("5891000")
rp_farallocation = RP_FarAllocation(
    Model_LanduseAllocation=na_landuseallocation.model,
    TotalArea=total_construction_area,
    FARRatio=construction_area_in_each_landuse,
    InputNach=c_script_2)
area_2 = Area(Geometry=na_landuseallocation.SiteLanduse)  # -> Area, Centroid
cluster_6 = Cluster_7(A=area_2.Area, B=rp_farallocation)
calcresult_total_construction_area = Panel(cluster_6)
cluster_7 = Cluster_6(B=cluster_6, data=na_landuseallocation.SitesPercentage, list_2=area_2.Area, list=rp_farallocation)
calcresult_construction_area_in_each_lan = Panel(cluster_7)  # "CalcResult_Construction Area in Each Landuse"

# ----
# visualization_site Landuse&FAR
number_slider = Slider(300, range=0..1000)
split_argb = SplitARGB(Colour=merge_3, IntegerChannels=True)  # -> Alpha, Red, Green, Blue
cluster_8 = Cluster_3(
    edges=na_landuseallocation.SiteLanduse,
    data_2=na_landuseallocation.SitesPercentage,
    data=rp_farallocation,
    domain_end=number_slider)  # -> unit_vector, extrusion, i, S
colour_rgb = ColourRGB(Alpha=Slider(180, range=0..255), Red=split_argb.Red, Green=split_argb.Green, Blue=split_argb.Blue)
move = Move(Geometry=area_2.Centroid, Motion=cluster_8.unit_vector)  # -> Geometry, Transform
c_script_3 = CSharpScript(labelList=cluster_8.S, colorList=colour_rgb)  # -> A; inputs labelList: list of String, colorList: list of Color
# ---------- c_script_3: C# usings ----------
using Rhino.Display;
using System.Drawing;
# ---------- c_script_3: C# ----------
    DataTree <Color> colorOutput = new DataTree<Color>();
    for (int i = 0; i < labelList.Count; i++)
    {
      GH_Path path = new GH_Path(i);
      switch (labelList[i])
      {
        case "R":
          colorOutput.Add(colorList[0], path);
          break;
        case "A":
          colorOutput.Add(colorList[1], path);
          break;
        case "G":
          colorOutput.Add(colorList[2], path);
          break;
        case "B":
          colorOutput.Add(colorList[3], path);
          break;
        case "M":
          colorOutput.Add(colorList[4], path);
          break;
        case "W":
          colorOutput.Add(colorList[5], path);
          break;
      }
    }
    A = colorOutput;
# ---------- end c_script_3 ----------
preview_2 = CustomPreview(Geometry=simplify(cluster_8.i), Material=c_script_3)
text_tag_3d = TextTag3D(
    Location=move.Geometry,
    Text=rp_farallocation,
    Size=Slider(22, range=0..100),
    Colour=ColourSwatch(SwatchColor=RGB(0, 0, 0)),
    Justification=7)

# ----
# 所属城市
value_list = ValueList({"北京": 0, "上海": 1, "天津": 2, "深圳": 3}, selected="深圳")

# ---- group: 将数据bake出来
curve_3 = Curve(na_landuseallocation.SiteLanduse)
data_9 = Data(rp_farallocation)
data_10 = Data(na_landuseallocation.SitesPercentage)
panel_3 = Panel("""LandUse
FAR
Density
MixRatio
Styles
Angle""")
c_script_4 = CSharpScript(x=data_10)  # -> A; inputs x: list of String
# ---------- c_script_4: C# ----------
    Dictionary < string, int> dic = new Dictionary<string, int>(){
        {"R",0},{"B",1},{"A",2},{"W",3},{"M",4}};
    var count = x.Count;
    var result = new int[count];
    for (int i = 0; i < count; i++)
    {
      var name = x[i];
      switch (name)
      {
        case "R":
          result[i] = 0;
          break;
        case "B":
          result[i] = 1;
          break;
        case "A":
          result[i] = 2;
          break;
        case "W":
          result[i] = 3;
          break;
        case "M":
          result[i] = 4;
          break;
      }
    }
    A = result;
# ---------- end c_script_4 ----------
list_length_2 = ListLength(List=data_10)
c_script_5 = CSharpScript(x=c_script_4)  # -> BuildingFAR, BuildingDensity, BuildingMixRatio, BuildingStyles, BuildingAngle; inputs x: list of Int32
# ---------- c_script_5: C# ----------
    List<double> farList = new List<double>();
    List<double> densityList = new List<double>();
    List<double> mixratioList = new List<double>();
    List<int> styleList = new List<int>();
    List<double> angleList = new List<double>();
    var ran = new Random();
    for (int i = 0; i < x.Count; i++)
    {
      if (x[i] == 0)
      {
        var farKey = ran.NextDouble() * (3d - 0.1) + 0.1;;
        var densityKey = ran.NextDouble() * (0.3 - 0.2) + 0.2;
        var mixratioKey = ran.NextDouble() * (0.3 - 0.1) + 0.1;
        int styleKey = ran.Next(2);
        var angleKey = ran.NextDouble() * (0.3 - 0d) + 0d;

        farList.Add(farKey);
        mixratioList.Add(mixratioKey);
        densityList.Add(densityKey);
        styleList.Add(styleKey);
        angleList.Add(angleKey);
      }
      else
      {
        var farKey = ran.NextDouble() * (6d - 1d) + 1d;
        var densityKey = ran.NextDouble() * (0.5 - 0.3) + 0.3;
        var mixratioKey = ran.NextDouble() * (0.5 - 0.1) + 0.1;
        //int styleKey = ran.Next(2) + 1;
        int styleKey = ran.Next(3);
        var angleKey = ran.NextDouble() * (0.3 - 0.1) + 0.1;

        farList.Add(farKey);
        mixratioList.Add(mixratioKey);
        densityList.Add(densityKey);
        styleList.Add(styleKey);
        angleList.Add(angleKey);

      }
    }
    BuildingFAR = farList;
    BuildingDensity = densityList;
    BuildingMixRatio = mixratioList;
    BuildingStyles = styleList;
    BuildingAngle = angleList;
# ---------- end c_script_5 ----------
series_2 = Series(Start=0, Step=1, Count=list_length_2)
cross_reference = CrossReference(ListListA=panel_3, ListListB=graft(series_2), CrossMode=1)  # -> simplify(ListListA), ListListB

# ---- group: 创建图层
create_set = CreateSet(List=data_10)  # -> Set, Map
create_modify_layers = CreateModifyLayers(LayerName=create_set.Set, DeleteLayer=False, enableFullPath=False)  # -> LayerNames, LayerFullPath

# ----
c_script_6 = CSharpScript(x=create_set.Set)  # -> A; inputs x: list of String
# ---------- c_script_6: C# ----------
    var result = new List<string>();
    for (int i = 0; i < x.Count; i++)
    {
      var temp = x[i];
      if (temp != "G")
      {
        result.Add(temp);
      }
    }
    A = result;
# ---------- end c_script_6 ----------
dynamic_geometry_pipeline = DynamicGeometryPipeline(
    LayerFilter=c_script_6,
    TypeFilter="Curve",
    NameFilter="*",
    GroupByLayer=False,
    GroupByType=False,
    IncludeHidden=True,
    IncludeLocked=True,
    enableFullPath=False,
    listenToAttributes=True)  # -> simplify(flatten(GeometryOut))
curve_4 = Curve(dynamic_geometry_pipeline)
object_attributes = ObjectAttributes(ObjectOrAttributes=curve_4)  # -> Name, LayerName, LayerFullPath, Color, MaterialName, LinetypeName, GroupIndices, PlotWeight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
list_item = ListItem(List=object_attributes.UserDataValues, Index=0, Wrap=True)  # -> flatten(Item), flatten(Item1), flatten(Item2), flatten(Item3), flatten(Item4), flatten(Item5)
c_script_7 = CSharpScript(x=list_item.Item)  # -> A; inputs x: list of String; same code as c_script_4
panel_4 = Panel(object_attributes.UserDataKeys)

division = Division(A=c_script_5.BuildingDensity, B=2)

ud_siteparameter = UD_SiteParameter(CleanedRoadsData=ns_computing3d.CleanedRoadsData, RoadsScores=ns_computing3d.MetricChoice, SitesCurves=curve_4)
ud_siteparameterextra = UD_SiteParameterExtra(
    SiteParameters=ud_siteparameter,
    SiteTypesEnum=c_script_7,
    TargetFAR=list_item.Item1,
    TargetDensity=list_item.Item2,
    MixRatios=list_item.Item3,
    BuidlingStyles=list_item.Item4)

# ---- group: 将数据bake出来 (continued)
merge_5 = Merge(
    Data1=graft(data_10),
    Data2=graft(c_script_5.BuildingFAR),
    Data3=graft(division),
    Data4=graft(c_script_5.BuildingMixRatio),
    Data5=graft(c_script_5.BuildingStyles),
    Data6=graft(c_script_5.BuildingAngle))  # -> simplify(Result)
createattributes = CreateAttributes(LayerName=graft(data_10), UserDataKeys=cross_reference.ListListA, UserDataValues=merge_5, enableFullPath=False)
bake_geometry = BakeGeometry(Bake=Toggle(True), Geometry=graft(curve_3), Attributes=createattributes, DeleteOldBakes=False, PreserveTrees=False)

# ----
# 3_auto-generate urban design
ud_sitegenerateplans = UD_SiteGeneratePlans(SiteParameters=ud_siteparameterextra, CityIndex=value_list)  # -> SiteResults, Sites, FARs, Densities, SubSites, SubSitesSetbacks, BuildingLayers, BuildingRoofs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

certainfacesbydirections = CertainFacesByDirections(brep=ud_sitegenerateplans.BuildingBreps, tolerance=0.98)  # -> topsrf, bottomsrf, sidessrf
cluster_9 = Cluster_9(geometry=certainfacesbydirections.topsrf, geometry_2=certainfacesbydirections.bottomsrf, B="3")  # -> z_component, result
brep_edges = BrepEdges(Brep=certainfacesbydirections.bottomsrf)  # -> Naked, Interior, NonManifold
data_11 = Data(ud_sitegenerateplans.BuildingFunctions)
join_curves = JoinCurves(Curves=brep_edges.Naked, Preserve=False)  # -> simplify(Curves)

# ---- group: 输出geojson_buildings文件
curve_5 = Curve(join_curves)
list_length_3 = ListLength(List=curve_5)
series_3 = Series(Start=0, Step=1, Count=list_length_3)
merge_6 = Merge(
    Data1=simplify(graft(series_3)),
    Data2=simplify(graft(data_11)),
    Data3=simplify(graft(cluster_9.z_component)),
    Data4=simplify(graft(cluster_9.result)))  # -> simplify(Result)
panel_5 = Panel("""id
Function
baseHeight
Floor""")
cross_reference_2 = CrossReference(ListListA=panel_5, ListListB=graft(series_3), CrossMode=1)  # -> simplify(ListListA), ListListB
feature_from_lines = FeatureFromLines(Curves=graft(curve_5), Keys=cross_reference_2.ListListA, Values=merge_6)
panel_6 = Panel(cross_reference_2.ListListA)
join_geojson = JoinGeoJSON(Features=flatten(feature_from_lines))
boolean_toggle_2 = BooleanToggle(False)
write_file = WriteFile(
    Directory="C:\Users\AlphonsePC\Downloads",
    Filename="buildings.geojson",
    Data=join_geojson,
    Run=boolean_toggle_2,
    Overwrite=boolean_toggle_2)

# ---- group: 输出geojson_subSitesSetbacks文件
curve_6 = Curve(ud_sitegenerateplans.SubSitesSetbacks)
feature_from_lines_2 = FeatureFromLines(Curves=graft(curve_6))
join_geojson_2 = JoinGeoJSON(Features=flatten(feature_from_lines_2))
boolean_toggle_3 = BooleanToggle(False)
write_file_2 = WriteFile(
    Directory="C:\Users\AlphonsePC\Downloads",
    Filename="subSitesSetbacks.geojson",
    Data=join_geojson_2,
    Run=boolean_toggle_3,
    Overwrite=boolean_toggle_3)

# ---- group: 输出geojson_subSites文件
curve_7 = Curve(ud_sitegenerateplans.SubSites)
feature_from_lines_3 = FeatureFromLines(Curves=graft(curve_7))
join_geojson_3 = JoinGeoJSON(Features=flatten(feature_from_lines_3))
boolean_toggle_4 = BooleanToggle(False)
write_file_3 = WriteFile(
    Directory="C:\Users\AlphonsePC\Downloads",
    Filename="subSites.geojson",
    Data=join_geojson_3,
    Run=boolean_toggle_4,
    Overwrite=boolean_toggle_4)

# ---- group: 输出geojson_sites文件
curve_8 = Curve(ud_sitegenerateplans.Sites)
list_length_4 = ListLength(List=curve_8)
series_4 = Series(Start=0, Step=1, Count=list_length_4)
ghpython_script = GhPythonScript(x=ud_sitegenerateplans.FARs, y=ud_sitegenerateplans.Densities, z=list_item.Item)  # -> a, b, c; inputs x: list, y: list, z: list
# ---------- ghpython_script: Python ----------
FAR=[]
Density=[]
for i in range(len(x)):
    single_far=x[i][4:]
    FAR.append(single_far)
    single_density=y[i][8:]
    Density.append(single_density)

a=z
b=FAR
c=Density
# ---------- end ghpython_script ----------
merge_7 = Merge(
    Data1=simplify(graft(series_4)),
    Data2=simplify(graft(ghpython_script.a)),
    Data3=simplify(graft(ghpython_script.b)),
    Data4=simplify(graft(ghpython_script.c)))  # -> simplify(Result)
panel_7 = Panel("""id
Landuse
FAR
Density""")
cross_reference_3 = CrossReference(ListListA=panel_7, ListListB=graft(series_4), CrossMode=1)  # -> simplify(ListListA), ListListB
panel_8 = Panel(cross_reference_3.ListListA)
feature_from_lines_4 = FeatureFromLines(Curves=graft(curve_8), Keys=cross_reference_3.ListListA, Values=merge_7)
join_geojson_4 = JoinGeoJSON(Features=flatten(feature_from_lines_4))
boolean_toggle_5 = BooleanToggle(False)
write_file_4 = WriteFile(
    Directory="C:\Users\AlphonsePC\Downloads",
    Filename="sites.geojson",
    Data=join_geojson_4,
    Run=boolean_toggle_5,
    Overwrite=boolean_toggle_5)

# ----
# visualization_function
cluster_10 = Cluster_8(brep=ud_sitegenerateplans.BuildingBreps, data=ud_sitegenerateplans.BuildingFunctions)  # -> brep_3, color
preview_3 = CustomPreview(Geometry=cluster_10.brep_3, Material=cluster_10.color)

# ----
# visualization
boundary_surfaces_2 = BoundarySurfaces(Edges=ud_sitegenerateplans.SubSitesSetbacks)
boundary_surfaces_3 = BoundarySurfaces(Edges=ud_sitegenerateplans.SubSites)
extrude = Extrude(Base=boundary_surfaces_3, Direction="0,0,0.10")
extrude_2 = Extrude(Base=boundary_surfaces_2, Direction=expr("x*2", "0,0,0.10"))
area_3 = Area(Geometry=ud_sitegenerateplans.BuildingRoofs)  # -> Area, Centroid
colour_swatch_7 = ColourSwatch(SwatchColor=RGB(102, 102, 102))
text_tag_3d_2 = TextTag3D(
    Location=area_3.Centroid,
    Text=ud_sitegenerateplans.BuildingFloors,
    Size=Slider(5, range=0..10),
    Colour=ColourSwatch(SwatchColor=RGB(0, 0, 0)),
    Justification=7)
custom_preview_3 = CustomPreview(Geometry=extrude, Material=ColourSwatch(SwatchColor=RGB(194, 194, 194)))
custom_preview_4 = CustomPreview(Geometry=ud_sitegenerateplans.BuildingBreps, Material=ColourSwatch(SwatchColor=RGBA(255, 255, 255, 197)))
custom_preview_5 = CustomPreview(Geometry=ud_sitegenerateplans.BuildingLayers, Material=colour_swatch_7)
custom_preview_6 = CustomPreview(Geometry=extrude_2, Material=ColourSwatch(SwatchColor=RGB(141, 171, 82)))

panel_9 = Panel(ud_sitegenerateplans.FARs)
panel_10 = Panel(ud_sitegenerateplans.Densities)
custom_preview_7 = CustomPreview(Geometry=ud_sitegenerateplans.BuildingRoofs, Material=colour_swatch_7)

# ==== cluster Cluster
tree = ClusterInput()
trim_tree = TrimTree(Tree=tree, Depth=1)
tree_2 = ClusterOutput(trim_tree)
tree_statistics = TreeStatistics(Tree=trim_tree)  # -> Paths, Length, Count
series = Series(Start=0, Step=1, Count=tree_statistics.Count)
bounds = Bounds(Numbers=series)
remap_numbers = RemapNumbers(Value=series, Source=bounds, Target=Domain(0, 1))  # -> Mapped, Clipped
gradient = Gradient(
    LowerLimit=0,
    UpperLimit=1,
    Parameter=remap_numbers.Mapped,
    stops=[0: RGB(0, 128, 0), 0.5: RGB(255, 255, 0), 1: RGB(255, 0, 0)])
colour = ClusterOutput(gradient)

# ==== cluster Cluster_2
data = ClusterInput()
L = ClusterInput()

data_2 = Data(flatten(data))
cset = CreateSet(List=data_2)  # -> Set, Map
mindex = MemberIndex(Set=data_2, Member=cset.Set)  # -> Index, Count
item = ListItem(List=L, Index=mindex.Index, Wrap=True)

S = ClusterOutput(cset.Set)
I = ClusterOutput(mindex.Index)
i = ClusterOutput(item)

# ==== cluster Cluster_3
domain_end = ClusterInput()
construct_domain = ConstructDomain(DomainStart="1", DomainEnd=domain_end)
data = ClusterInput()
data_2 = ClusterInput()
edges = ClusterInput()
data_3 = Data(data)
bounds = Bounds(Numbers=data_3)
boundary_surfaces = BoundarySurfaces(Edges=graft(edges))
remap_numbers = RemapNumbers(Value=data_3, Source=bounds, Target=Domain(0, 1))  # -> Mapped, Clipped
graph_mapper = GraphMapper(
    remap_numbers.Mapped,
    x0=0,
    x1=1,
    y0=0,
    y1=1,
    container_name="Bezier",
    cpx=[0, 0.7485014796, 0.5181000829, 1],
    cpy=[0, 0.2153329253, 0.5784673691, 0.8697323799])
remap_numbers_2 = RemapNumbers(Value=graph_mapper, Source=Domain(0, 1), Target=construct_domain)  # -> Mapped, Clipped
unit_z = UnitZ(Factor=remap_numbers_2.Mapped)
extrude = Extrude(Base=boundary_surfaces, Direction=graft(unit_z))
cluster = Cluster_2(L=flatten(extrude), data=data_2)  # -> I, i, S
unit_vector = ClusterOutput(unit_z)
extrusion = ClusterOutput(extrude)
i = ClusterOutput(cluster.i)
S = ClusterOutput(cluster.S)

# ==== cluster Cluster_4
data = ClusterInput()
data_2 = Data(data)
bounds = Bounds(Numbers=data_2)
remap_numbers = RemapNumbers(Value=data_2, Source=bounds, Target=Domain(0, 1))  # -> Mapped, Clipped
mapped = ClusterOutput(remap_numbers.Mapped)

# ==== cluster Cluster_6
data = ClusterInput()
list = ClusterInput()
list_2 = ClusterInput()
data_2 = Data(data)
cluster = Cluster_5(list=list, data=data_2)  # -> i, set
cluster_2 = Cluster_5(list=list_2, data=data_2)  # -> i, set
multiplication = Multiplication(A=cluster_2.i, B=cluster.i)
mass_addition = MassAddition(Input=multiplication)  # -> Result, PartialResults
B = ClusterInput()
division = Division(A=mass_addition.Result, B=B)
concatenate = Concatenate(Fragment_A=cluster_2.set, Fragment_B=flatten(":"), A=flatten(division))
result = ClusterOutput(concatenate)

# ==== cluster Cluster_7
A = ClusterInput()
B = ClusterInput()
multiplication = Multiplication(A=A, B=B)
mass_addition = MassAddition(Input=multiplication)  # -> Result, PartialResults
result = ClusterOutput(mass_addition.Result)

# ==== cluster Cluster_8
brep = ClusterInput()
data = ClusterInput()

# ---- group: H
colour_swatch = ColourSwatch(SwatchColor=RGB(245, 177, 5))

# ---- group: R
colour_swatch_2 = ColourSwatch(SwatchColor=RGB(255, 225, 0))

# ---- group: o
colour_swatch_3 = ColourSwatch(SwatchColor=RGBA(200, 0, 255, 210))

# ---- group: M
colour_swatch_4 = ColourSwatch(SwatchColor=RGB(12, 69, 112))

# ---- group: W
colour_swatch_5 = ColourSwatch(SwatchColor=RGB(104, 75, 150))

# ---- group: c
colour_swatch_6 = ColourSwatch(SwatchColor=RGB(212, 15, 15))

# ----
brep_2 = Brep(flatten(brep))
data_2 = Data(flatten(data))
cset = CreateSet(List=data_2)  # -> Set, Map
mindex = MemberIndex(Set=data_2, Member=cset.Set)  # -> Index, Count
item = ListItem(List=brep_2, Index=mindex.Index, Wrap=True)

merge = Merge(
    Data1=colour_swatch_6,
    Data2=colour_swatch,
    Data3=colour_swatch_2,
    Data4=colour_swatch_3,
    Data5=colour_swatch_4,
    Data6=colour_swatch_5)
txt = Text(merge)
c_script = CSharpScript(labelList=cset.Set, colorList=txt)  # -> A; inputs labelList: list of String, colorList: list of String
# ---------- c_script: C# usings ----------
using Rhino.Display;
# ---------- c_script: C# ----------
    DataTree <string> colorOutput = new DataTree<string>();
    for (int i = 0; i < labelList.Count; i++)
    {
      GH_Path path = new GH_Path(i);
      switch (labelList[i])
      {
        case "C":
          colorOutput.Add(colorList[0], path);
          break;
        case "H":
          colorOutput.Add(colorList[1], path);
          break;
        case "R":
          colorOutput.Add(colorList[2], path);
          break;
        case "O":
          colorOutput.Add(colorList[3], path);
          break;
        case "M":
          colorOutput.Add(colorList[4], path);
          break;
        case "W":
          colorOutput.Add(colorList[5], path);
          break;
      }
    }
    A = colorOutput;
# ---------- end c_script ----------
brep_3 = ClusterOutput(item)
color = ClusterOutput(c_script)

# ==== cluster CertainFacesByDirections: get certain faces by direction
brep = ClusterInput()
tolerance = ClusterInput()
debrep = DeconstructBrep(Brep=brep)  # -> Faces, Edges, Vertices
tol = Number(tolerance)
Z = UnitZ(Factor=1)
srfcen = SurfaceCenter(srf=debrep.Faces)  # -> point, normal, frame
dprod = DotProduct(VectorA=srfcen.normal, VectorB=Z, Unitize=True)
abs = Absolute(Value=dprod)
neg = Negative(Value=dprod)
larger = LargerThan(FirstNumber=dprod, SecondNumber=tol)  # -> LargerThan, OrEqualTo
larger_2 = LargerThan(FirstNumber=abs, SecondNumber=tol)  # -> LargerThan, OrEqualTo
larger_3 = LargerThan(FirstNumber=neg, SecondNumber=tol)  # -> LargerThan, OrEqualTo
dispatch = Dispatch(List=debrep.Faces, DispatchPattern=larger.LargerThan)  # -> ListA, ListB
dispatch_2 = Dispatch(List=debrep.Faces, DispatchPattern=larger_3.LargerThan)  # -> ListA, ListB
dispatch_3 = Dispatch(List=debrep.Faces, DispatchPattern=larger_2.LargerThan)  # -> ListA, ListB
top = Srf(dispatch.ListA)
btm = Srf(dispatch_2.ListA)
sides = Srf(dispatch_3.ListB)
topsrf = ClusterOutput(top)
bottomsrf = ClusterOutput(btm)
sidessrf = ClusterOutput(sides)

# ==== cluster Cluster_9
geometry = ClusterInput()
geometry_2 = ClusterInput()
area = Area(Geometry=geometry)  # -> Area, Centroid
area_2 = Area(Geometry=geometry_2)  # -> Area, Centroid
deconstruct = Deconstruct(Point=area_2.Centroid)  # -> XComponent, YComponent, simplify(ZComponent)
deconstruct_2 = Deconstruct(Point=area.Centroid)  # -> XComponent, YComponent, simplify(ZComponent)
B = ClusterInput()
subtraction = Subtraction(A=deconstruct_2.ZComponent, B=deconstruct.ZComponent)
division = Division(A=subtraction, B=B)  # -> simplify(Result)
z_component = ClusterOutput(deconstruct.ZComponent)
result = ClusterOutput(division)

# ==== cluster Cluster_5
data = ClusterInput()
data_2 = Data(data)
create_set = CreateSet(List=data_2)  # -> Set, Map
member_index = MemberIndex(Set=data_2, Member=create_set.Set)  # -> Index, Count
list = ClusterInput()
list_item = ListItem(List=list, Index=member_index.Index, Wrap=True)  # -> simplify(Item)
i = ClusterOutput(list_item)
set = ClusterOutput(create_set.Set)

# ==== cluster SurfaceCenter: Evaluates a surface at UV .5,.5
srf = ClusterInput()
srf_2 = Srf(srf)
evaluate_surface = EvaluateSurface(Surface=reparameterize(srf_2), Point="0.5,0.5,0")  # -> Point, Normal, UDirection, VDirection, Frame
point = ClusterOutput(evaluate_surface.Point)
normal = ClusterOutput(evaluate_surface.Normal)
frame = ClusterOutput(evaluate_surface.Frame)
