# Grasshopper definition centroidLineExtract.gh (Grasshopper 1.0.7)
# plug-ins: UrbanXTools, Geospatial, Human

file_path = FilePath("C:\Users\AlphonsePC\Downloads\temp\roads_output_only_geoms_32650.geojson")
read_geojson = ReadGeoJSON(File=file_path)  # -> Type, Geometry, Keys, Values

curve = Curve([<curve referenced from the Rhino model> x5000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])
centerlineextraction = CenterLineExtraction(
    InputCurve=curve,
    GridSize=Slider(1000, range=0..1000),
    BufferDist=Slider(10, range=0..100),
    InterpolateDist=Slider(40, range=0..100),
    Epsilon=Slider(45, range=0..100),
    SegmentThreshold=Slider(10, range=0..1000))

curve_2 = Curve([<curve referenced from the Rhino model> x18])
centerlineextractionfrombuffer = CenterLineExtractionFromBuffer(InputCurve=curve_2, InterpolateDist=Slider(100, range=0..1000), Epsilon=Slider(50, range=0..1000), SegmentThreshold=10)

list_length = ListLength(List=curve)
curve_3 = Curve(flatten(read_geojson.Geometry))
custom_preview_lineweights = CustomPreviewLineweights(Geometry=curve, Shader=ColourSwatch(SwatchColor=RGB(255, 255, 255)), Absolute=False)
custom_preview_lineweights_2 = CustomPreviewLineweights(
    Geometry=centerlineextraction,
    Shader=ColourSwatch(SwatchColor=RGB(51, 255, 0)),
    Thickness=Slider(3, range=0..10),
    Absolute=False)
