# Grasshopper definition TimeVarientCalc.gh (Grasshopper 1.0.7)
# plug-ins: LunchBox, UrbanXTools, Human

# ---- group: Import Inundation map
file_path = FilePath("D:\Code\114_temp\040_UrbanXTools\UrbanXTools_v.3.0.1\UrbanXTools-main\Samples\1_NetworkAnalysis\output_even_rows.csv")
read_file = ReadFile(File=file_path, PerLineParse=True)
read_csv = ReadCSV(CSVString=read_file, Delimiter=",")  # -> Headers, Values
flip_matrix = FlipMatrix(Data=read_csv.Values)
tree_statistics = TreeStatistics(Tree=flip_matrix)  # -> Paths, Length, Count
dispatch = Dispatch(List=tree_statistics.Paths, DispatchPattern=[True, False])  # -> ListA, ListB

# ----
curve = Curve([<curve referenced from the Rhino model> x5000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])
list_length = ListLength(List=curve)
series = Series(Start=0, Step=1, Count=list_length)
tree_branch = TreeBranch(Tree=flip_matrix, Path=dispatch.ListA, MaintainPaths=True)
list_item = ListItem(List=tree_branch, Index=0, Wrap=True)  # -> flatten(Item)
larger_than = LargerThan(FirstNumber=list_item, SecondNumber=Slider(3, range=0..10))  # -> LargerThan, OrEqualTo
dispatch_2 = Dispatch(List=series, DispatchPattern=larger_than.LargerThan)  # -> ListA, ListB
list_item_2 = ListItem(List=curve, Index=dispatch_2.ListA, Wrap=True)
ns_computing3d = NS_Computing3D(RoadsData=list_item_2, Radius="500", Merge=False)  # -> MetricChoice, MetricIntegration, MetricMeanDepth, MetricTotalDepth, AngularChoice, AngularIntegration, AngularMeanDepth, AngularTotalDepth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; disabled

# ---- group: visualization
data = Data(ns_computing3d.MetricChoice)
bounds = Bounds(Numbers=data)
remap_numbers = RemapNumbers(Value=data, Source=bounds, Target=Domain(0, 1))  # -> Mapped, Clipped
gradient = Gradient(
    LowerLimit=0,
    UpperLimit=1,
    Parameter=remap_numbers.Mapped,
    stops=[0: RGB(0, 128, 0), 0.271: RGB(255, 255, 0), 0.57: RGB(255, 0, 0)])
custom_preview_lineweights = CustomPreviewLineweights(Geometry=ns_computing3d.CleanedRoadsData, Shader=gradient, Thickness=Slider(3, range=0..10), Absolute=False)

# ----
entwine = Entwine(Branch01=ns_computing3d.MetricChoice, Branch02=ns_computing3d.AngularChoice, FlattenInputs=True)

# ---- group: Export Data
list_item_3 = ListItem(List=read_csv.Headers, Index=Slider(17, range=1..17), Wrap=True)  # -> flatten(Item)
panel = Panel(list_item_3)
panel_2 = Panel("""M_{0}
A_{0}""")
format = Format(Format="Input Your Path!!!", Culture=127, Data0="500", Data1=panel)
format_2 = Format(Format=panel_2, Culture=127, Data0=panel)
create_csv = CreateCSV(DataGridHeaders=format_2, ValueTree=entwine, Delimiter=",")
exportcsv = ExportCsv(export_path=format, export=Toggle(False), data=create_csv)  # -> A; inputs export_path: String, export: Boolean, data: list of String
# ---------- exportcsv: C# usings ----------
using System.Text;
using System.IO;
# ---------- exportcsv: C# ----------
    if (export == true)
    {
      //string strSeperator = ",";
      StringBuilder sbOutput = new StringBuilder();
      for (int i = 0; i < data.Count; i++)
      {
        sbOutput.AppendLine(data[i]);
      }
      File.WriteAllText(export_path, sbOutput.ToString());
      A = "successful!";
    }
    else{
      A = "did not export";
    }
# ---------- end exportcsv ----------
